% Simulink data dictionary AEBfinal_MotarConfig.sldd

iostack = struct(
  ioStackConfig=struct(
    EnableAdc=0,
    EnableDio=0,
    EnableIcu=0,
    EnableOcu=0,
    EnablePort=0,
    EnablePvg=0,
    EnablePwd=0,
    EnablePwm=0,
    EnableSpi=0,
    EnableVout=0,
    EnableIoHwAb=0),
  adcConfig=struct(
    ConfigName="Motar",
    DevelopmentErrorDetect=0,
    VersionInfoApi=0,
    AdcDeinitApi=0,
    GrpNotifCapability=0,
    StartStopGrpApi=0,
    ReadGrpApi=0,
    HwTriggerApi=0,
    Queuing=0,
    HwResolution=32,
    HwDischargeBeforeSampling=1,
    MaxTime=65535,
    ChannelGroups=[]),
  dioConfig=struct(
    ConfigName="Motar",
    DevelopmentErrorDetect=0,
    VersionInfoApi=0,
    Ports=[],
    Channels=[],
    ChannelGroups=[],
    possibleDirection=[]),
  icuConfig=struct(
    ConfigName="Motar",
    DevelopmentErrorDetect=0,
    VersionInfoApi=0,
    IcuDeinitApi=1,
    DisableWakeupApi=1,
    EdgeCountApi=1,
    EnableWakeupApi=1,
    GetDutycycleValuesApi=1,
    GetInputStateApi=1,
    GetTimeElapsedApi=1,
    ReportWakeupSource=0,
    SetModeApi=0,
    SignalMeasurementApi=1,
    TimestampApi=1,
    TimerScaler=0,
    Channels=[]),
  ocuConfig=struct(
    ConfigName="Motar",
    DevelopmentErrorDetect=0,
    VersionInfoApi=0,
    OcuDeinitApi=0,
    SetPinStateApi=1,
    SetPinActionApi=1,
    SetAbsoluteThresholdApi=1,
    SetRelativeThresholdApi=1,
    GetCounterValueApi=1,
    NotificationSupported=1,
    TimerScaler=0,
    Channels=[]),
  portConfig=struct(
    ConfigName="Motar",
    DevelopmentErrorDetect=0,
    VersionInfoApi=0,
    PinModeApi=0,
    PinDirectionApi=0,
    Ports=[],
    DxPins=[]),
  pvgConfig=struct(ConfigName="Motar", DevelopmentErrorDetect=0, VersionInfoApi=0, Channels=[]),
  pwdConfig=struct(ConfigName="Motar", DevelopmentErrorDetect=0, Channels=[]),
  pwmConfig=struct(
    ConfigName="Motar",
    DevelopmentErrorDetect=0,
    VersionInfoApi=0,
    PwmDeinitApi=0,
    SetDutyCycleApi=1,
    SetPeriodAndDutyApi=0,
    SetOutputIdleApi=1,
    GetOutputStateApi=0,
    DutyCycleUpdatedEndperiod=0,
    DutyPeriodUpdatedEndperiod=0,
    NotificationSupported=0,
    ScaleA=0,
    ScaleB=0,
    PrescalePckA=1,
    PrescalePckB=1,
    Concat01=0,
    Concat23=0,
    Concat45=0,
    Concat67=0,
    Channels=[]),
  spiConfig=struct(
    ConfigName="Motar",
    DevelopmentErrorDetect=0,
    VersionInfoApi=0,
    MaxTime=65535,
    Channels=[],
    Jobs=[],
    Sequences=[],
    HWUnits=[]),
  voutConfig=struct(ConfigName="Motar", DevelopmentErrorDetect=0, VersionInfoApi=0, Channels=[]),
  iohwabConfig=struct(ConfigName="Motar", ExtSignals=[], SpiGroups=[]))

memstack = struct(
  memStackConfig=struct(EnableEep=0, EnableFls=0),
  eepConfig=struct(
    ConfigName="Motar",
    DevelopmentErrorDetect=1,
    VersionInfoApi=1,
    UseInterrupts=0,
    WriteCycleReduction=1,
    SlowReadBlockSize=1,
    SlowWriteBlockSize=4,
    FastReadBlockSize=4,
    FastWriteBlockSize=8,
    DefaultMode="SLOW"),
  flsConfig=struct(
    ConfigName="Motar",
    DevelopmentErrorDetect=1,
    VersionInfoApi=1,
    UseInterrupts=0,
    AcLoadOnJobStart=1,
    CancelApi=1,
    CompareApi=1,
    SetModeApi=1,
    GetStatusApi=1,
    GetJobResultApi=1,
    WriteProtection=1,
    MaxWriteSlowMode=16,
    MaxWriteFastMode=128,
    MaxReadSlowMode=16,
    MaxReadFastMode=128,
    DefaultMode="SLOW"),
  eaConfig=struct(
    ConfigName="Motar",
    DevelopmentErrorDetect=1,
    VersionInfoApi=1,
    SetModeSupported=1,
    PollingMode=1,
    VirtualPageSize=2,
    LargestBlockSize=0,
    Blocks=[]),
  feeConfig=struct(
    ConfigName="Motar",
    DevelopmentErrorDetect=1,
    VersionInfoApi=1,
    PollingMode=1,
    VirtualPageSize=512,
    LargestBlockSize=0,
    Blocks=[]),
  nvmConfig=struct(
    ConfigName="Motar",
    DevelopmentErrorDetect=1,
    VersionInfoApi=1,
    JobPrioritization=1,
    PollingMode=1,
    ImmediateJobQueueSize=8,
    StandardJobQueueSize=8,
    ApiConfigClass=3,
    Blocks=[]))

Motar_Pdu_Distance_BusType = Simulink.Bus()
  Distance: uint8

Motar_Pdu_Speed_BusType = Simulink.Bus()
  Speed: uint8

Motar_Pdu_AEBswitch_BusType = Simulink.Bus()
  AEBswitch: uint8

Motar_Pdu_Brake_BusType = Simulink.Bus()
  Brake: uint8
  WarningLamp: uint8

Motar_Pdu_BackupDistance_BusType = Simulink.Bus()
  BackupDistance: uint8

comstack = struct(
  ComStackConfig=struct(EnableCan=1, EnableCanTrcv=0, EnableLin=0, EnableNm=0, EnableXcp=false, EnableEth=false, EnableJ1939=0),
  Buses={struct(Can="CAN0", Name="CanBus", Baudrate="500")},
  Frames={struct(
    Name="MotarLicenseDebug",
    Channel="CanBus",
    Id="0",
    Dlc="8",
    DlcCheck="TRUE",
    Dir="Tx",
    User="Motar",
    IdType="STD",
    Type="CAN"), struct(
    Name="Distance",
    Channel="CanBus",
    Id="1",
    Dlc="8",
    DlcCheck="TRUE",
    Dir="Rx",
    User="PduR",
    IdType="STD",
    Type="CAN"), struct(
    Name="Speed",
    Channel="CanBus",
    Id="2",
    Dlc="8",
    DlcCheck="TRUE",
    Dir="Rx",
    User="PduR",
    IdType="STD",
    Type="CAN"), struct(
    Name="AEBswitch",
    Channel="CanBus",
    Id="3",
    Dlc="8",
    DlcCheck="TRUE",
    Dir="Rx",
    User="PduR",
    IdType="STD",
    Type="CAN"), struct(
    Name="Brake",
    Channel="CanBus",
    Id="5",
    Dlc="8",
    DlcCheck="TRUE",
    Dir="Tx",
    User="PduR",
    IdType="STD",
    Type="CAN"), struct(
    Name="BackupDistance",
    Channel="CanBus",
    Id="4",
    Dlc="8",
    DlcCheck="TRUE",
    Dir="Rx",
    User="PduR",
    IdType="STD",
    Type="CAN")},
  PDUS={struct(
    Name="Pdu_Distance",
    Size="8",
    LoObject="Distance",
    Type="CAN",
    Mode="NONE",
    Period="N/A",
    Signals={struct(
      Name="Distance",
      Pos="0",
      Size="8",
      Init="0",
      Endian="LITTLE_ENDIAN",
      Type="uint8",
      Timeout="0",
      IsGroup="No",
      GroupSignals=[])}), struct(
    Name="Pdu_Speed",
    Size="8",
    LoObject="Speed",
    Type="CAN",
    Mode="NONE",
    Period="N/A",
    Signals={struct(
      Name="Speed",
      Pos="0",
      Size="8",
      Init="0",
      Endian="LITTLE_ENDIAN",
      Type="uint8",
      Timeout="0",
      IsGroup="No",
      GroupSignals=[])}), struct(
    Name="Pdu_AEBswitch",
    Size="8",
    LoObject="AEBswitch",
    Type="CAN",
    Mode="NONE",
    Period="N/A",
    Signals={struct(
      Name="AEBswitch",
      Pos="0",
      Size="8",
      Init="0",
      Endian="LITTLE_ENDIAN",
      Type="uint8",
      Timeout="0",
      IsGroup="No",
      GroupSignals=[])}), struct(
    Name="Pdu_Brake",
    Size="8",
    LoObject="Brake",
    Type="CAN",
    Mode="PERIODIC",
    Period="10",
    Signals={struct(
      Name="Brake",
      Pos="0",
      Size="8",
      Init="0",
      Endian="BIG_ENDIAN",
      Type="uint8",
      Timeout="0",
      IsGroup="No",
      GroupSignals=[]), struct(
      Name="WarningLamp",
      Pos="8",
      Size="8",
      Init="0",
      Endian="BIG_ENDIAN",
      Type="uint8",
      Timeout="0",
      IsGroup="No",
      GroupSignals=[])}), struct(
    Name="Pdu_BackupDistance",
    Size="8",
    LoObject="BackupDistance",
    Type="CAN",
    Mode="NONE",
    Period="10",
    Signals={struct(
      Name="BackupDistance",
      Pos="0",
      Size="8",
      Init="0",
      Endian="LITTLE_ENDIAN",
      Type="uint8",
      Timeout="0",
      IsGroup="No",
      GroupSignals=[])})},
  Schedules={struct(Name="ScheduleTable1", Entries=[])},
  Sockets=[],
  PGs=[],
  CanConfig=struct(ConfigName="Motar", DevErrorDetect="0", VersionInfoApi="0"),
  CanTrcvConfig=struct(ConfigName="Motar", DevErrorDetect="0", VersionInfoApi="0", DioChannel_STB="", DioChannel_EN=""),
  CanIfConfig=struct(ConfigName="Motar", DevErrorDetect="0", VersionInfoApi="0"),
  CanNmConfig=struct(
    ConfigName="Motar",
    DevErrorDetect="0",
    VersionInfoApi="0",
    Frame="NmFrame",
    NodeId="0",
    TimeoutTime="200",
    RepeatMessageTime="500",
    WaitBusSleepTime="4000",
    MessageCycleTime="50",
    MessageCycleOffsetTime="0",
    MessageTimeoutTime="1000"),
  LinConfig=struct(ConfigName="Motar", DevErrorDetect="0", VersionInfoApi="0", Baudrate="19200", SciPort="0"),
  LinIfConfig=struct(ConfigName="Motar", DevErrorDetect="0", VersionInfoApi="0"),
  PduRConfig=struct(ConfigName="Motar", DevErrorDetect="0", VersionInfoApi="0"),
  ComConfig=struct(ConfigName="Motar", DevErrorDetect="0", VersionInfoApi="0"),
  XcpConfig=struct(
    ConfigName="Motar",
    DevErrorDetect="0",
    VersionInfoApi="0",
    SeedKeyEnabled="0",
    Operations=[],
    Protocol="CAN",
    TxLoObject="XcpFrame",
    RxLoObject="XcpFrame"),
  UdpConfig=struct(ConfigName="Motar", DevErrorDetect="0", Baudrate=100, LocalIP="10.100.30.200", RemoteIP="0.0.0.0"),
  SoAdConfig=struct(ConfigName="Motar", DevErrorDetect="0", DlcCheck="1"),
  J1939NmConfig=struct(
    ConfigName="Motar",
    DevErrorDetect="0",
    NodeName="Node01",
    CanChannel="CanBus",
    StartUpDelay="1",
    PreferredSA="0",
    AAC="0",
    IndustryGroupID="0",
    IndustryGroupDescription="Global, applies to all",
    VehicleSystemID="0",
    VehicleSystemDescription="Non-Specific System",
    VSInstance="0",
    FunctionID="30",
    FunctionDescription="Management Computer",
    FunctionInstance="0",
    ECUInstance="0",
    ManufacturerCode="0",
    IdentityNumber="0"),
  J1939Config=struct(ConfigName="Motar", DevErrorDetect="0"))

sysstack = struct(
  sysStackConfig=struct(EnableWdg=0, EnableWdgExt=0, EnableWdgIf=0, EnableDet=0),
  wdgConfig=struct(
    ConfigName="Motar",
    DevelopmentErrorDetect=1,
    VersionInfoApi=0,
    SlowRate=7,
    SlowMode="NORMAL",
    SlowClock="OSCCLK",
    FastRate=7,
    FastMode="NORMAL",
    FastClock="OSCCLK"),
  wdgExtConfig=struct(ConfigName="Motar"),
  mcuConfig=struct(
    ConfigName="Motar",
    DevelopmentErrorDetect=1,
    VersionInfoApi=0,
    InitClock=1,
    NoPll=0,
    NoExtOsc=0,
    InitRamSection=0,
    PerformResetApi=0,
    GetRamStateApi=0,
    OscclkKhz=8000,
    BusclkKhz=25000,
    RamMatrix={struct(BaseAddress=0, Size=0, Value=0)}))